% Simulink data dictionary common_data.sldd

VARIANT_QUBE_STOPPER_ON = Simulink.Variant(Condition="QUBE_STOPPER_ACTIVE == 1")
VARIANT_QUBE_STOPPER_OFF = Simulink.Variant(Condition="QUBE_STOPPER_ACTIVE == 0")
init_time = Simulink.Parameter(1)
angle_limit = Simulink.Parameter(Simulink.data.Expression(ExpressionString="3*pi/4"))
tf_raspi = Simulink.Parameter(10)
Volt_Limit = Simulink.Parameter(12)
QUBE_STOPPER_ACTIVE = Simulink.Parameter(0)
ts_raspi = Simulink.Parameter(0.005)
Controller_Config_sim = Simulink.ConfigSet(StartTime="0", StopTime="10", FixedStep="ts_PID", Solver="FixedStepDiscrete", ProdHWDeviceType="Intel->x86-64 (Windows64)", SystemTargetFile="ert.tlc", TargetLang="C")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
ts_PID = Simulink.Parameter(0.005)
Controller_Config_raspi_ARM = Simulink.ConfigSet(StartTime="0", StopTime="10", FixedStep="ts_PID", Solver="FixedStepDiscrete", ProdHWDeviceType="ARM Compatible->ARM Cortex", SystemTargetFile="ert.tlc", HardwareBoard="Raspberry Pi", TargetLang="C++")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
Controller_Config_raspi_PIL = Simulink.ConfigSet(StartTime="0", StopTime="10", FixedStep="ts_PID", Solver="FixedStepDiscrete", ProdHWDeviceType="ARM Compatible->ARM Cortex", SystemTargetFile="ert.tlc", HardwareBoard="Raspberry Pi", TargetLang="C")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
Controller_Config_raspi = Simulink.ConfigSet(StartTime="0", StopTime="tf_raspi", FixedStep="ts_PID", Solver="FixedStepDiscrete", ProdHWDeviceType="ARM Compatible->ARM Cortex", SystemTargetFile="ert.tlc", HardwareBoard="Raspberry Pi", TargetLang="C")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